# Dynamo graph Modify_Grid_Leaders.dyn (Dynamo 1.3.3.4111)

select_model_elements = DSModelElementsSelection()  # 1 picked in the model
code_block = CodeBlock(grid=select_model_elements)
# ---------- code_block.designscript (2 lines) ----------
//grid to be modified
grid;
# ----------------------------------------
code_block_2 = CodeBlock()
# ---------- code_block_2.designscript (4 lines) ----------
//select views by name
"LEVEL";
false;
true;
# ----------------------------------------
python_script = Python(IN[0]=code_block_2.out0, IN[1]=code_block_2.out1, IN[2]=code_block_2.out2)
# ---------- python_script.python (43 lines) ----------
#Copyright(c) 2016, Dimitar Venkov
# @5devene, dimitar.ven@gmail.com

import clr

clr.AddReference("RevitServices")
import RevitServices
from RevitServices.Persistence import DocumentManager
doc = DocumentManager.Instance.CurrentDBDocument

clr.AddReference("RevitAPI")
from Autodesk.Revit.DB import *

clr.AddReference("RevitNodes")
import Revit
clr.ImportExtensions(Revit.Elements)

def tolist(obj1):
	if hasattr(obj1,"__iter__"): return obj1
	else: return [obj1]

fn = map(str,tolist(IN[0]) )
IncSchedules = IN[1]
result, similar, names = [], [], []

if IncSchedules: exclude = ("DrawingSheet")
else: exclude = ("DrawingSheet", "Schedule")
fec = FilteredElementCollector(doc).OfClass(View)
for i in fec:
	if not i.IsTemplate and not i.ViewType.ToString() in exclude:
		n1 = i.Name
		
		names.append(i)
		if any(fn1 == n1 for fn1 in fn):
			result.append(i.ToDSType(True))
		elif any(fn1.lower() in n1.lower() for fn1 in fn):
			similar.append(i.ToDSType(True))
if len(result) > 0:
	OUT = result,similar
if len(result) == 0 and len(similar) > 0:
	OUT = "No exact match found. Check partial below:", similar
if len(result) == 0 and len(similar) == 0:
	OUT = "No match found! Check names below:", names
# ----------------------------------------
code_block_3 = CodeBlock(v=python_script) { v[0]; v[1]; }
code_block_4 = CodeBlock(views=code_block_3.out1) { views[{0,2,4}]; }
flatten = Flatten(code_block_4)
views = Views("LEVEL 00")
code_block_5 = CodeBlock(view=views)
# ---------- code_block_5.designscript (2 lines) ----------
//Select View to be used as a template - where the grid looks the way you want
view;
# ----------------------------------------
boolean = BoolSelector(false)
code_block_6 = CodeBlock(startend=boolean)
# ---------- code_block_6.designscript (2 lines) ----------
//Is it the start or end of the grid?
startend;
# ----------------------------------------
python_script_2 = Python(IN[0]=code_block, IN[1]=flatten, IN[2]=code_block_5, IN[3]=code_block_6)
# ---------- python_script_2.python (123 lines) ----------
import clr
clr.AddReference('ProtoGeometry')
from Autodesk.DesignScript.Geometry import *

clr.AddReference("RevitNodes")
import Revit
clr.ImportExtensions(Revit.Elements)

clr.ImportExtensions(Revit.GeometryConversion)

clr.AddReference("RevitServices")
import RevitServices

from RevitServices.Persistence import *
from RevitServices.Transactions import TransactionManager
from System.Collections.Generic import *

clr.AddReference("RevitAPI")
import Autodesk
from Autodesk.Revit.DB import *

doc = DocumentManager.Instance.CurrentDBDocument
uiapp = DocumentManager.Instance.CurrentUIApplication
app = uiapp.Application
uidoc = DocumentManager.Instance.CurrentUIApplication.ActiveUIDocument

import sys
#Specify location path for IronPython install
pyt_path = r'C:\Program Files (x86)\IronPython 2.7\Lib'
sys.path.append(pyt_path)

#The inputs to this node will be stored as a list in the IN variable.
dataEnteringNode = IN

def ProcessList(_func, _list):
    return map( lambda x: ProcessList(_func, x) if type(x)==list else _func(x), _list )

def UnwrapNestedList(e):
	return UnwrapElement(e)
def DoStuff(e):
	return e


if isinstance(IN[0], list):
	grids = ProcessList(UnwrapNestedList, IN[0])
else:
	grids = [UnwrapElement(IN[0])]

if isinstance(IN[1], list):
	views = ProcessList(UnwrapNestedList, IN[1])
else:
	views = [UnwrapElement(IN[1])]


vt = UnwrapElement(IN[2])

if IN[3]==True:
	ends = DatumEnds.End0
else:
	ends = DatumEnds.End1


TransactionManager.Instance.EnsureInTransaction(doc)
leaders=[]



for v in views:
	for i in grids:
		try:
			errorReport = None
			#i.HideBubbleInView(ends,v)
			#i.ShowBubbleInView(DatumEnds.End0,v)
			
			leadtmp = i.GetLeader(ends,vt)
			ltex = leadtmp.End.X
			ltey = leadtmp.End.Y
			ltelx = leadtmp.Elbow.X
			ltely = leadtmp.Elbow.Y
			
			try:
				newlead = i.AddLeader(ends,v)
				lead = i.GetLeader(ends,v)
				xx=1
			except:
				lead = i.GetLeader(ends,v)
				xx=2
			else:
				lead = i.GetLeader(ends,v)
				xx=3
			#anchor = lead.Anchor
			#lead = i.AddLeader(DatumEnds.End0,v)
			#lead = i.GetLeader(DatumEnds.End0,v)
			vr = v.GetViewRange()
			of = vr.GetOffset(PlanViewPlane.CutPlane)
			vz = v.Origin.Z+of
			if xx ==1:
				lead.Elbow = XYZ(ltelx,ltely,vz)
				lead.End = XYZ(ltex,ltey,vz)
			else:
				lead.Elbow = XYZ(ltelx,ltely,lead.Elbow.Z)
				lead.End = XYZ(ltex,ltey,lead.End.Z)
			#lead.Elbow = XYZ(lead.Elbow.X,lead.Elbow.Y,v.Origin.Z+5.41338582677164)
			#lead.End = XYZ(lead.End.X,lead.End.Y,v.Origin.Z+5.41338582677164)
			#newlead.Elbow  = XYZ(359.126307489,126.075627313,78.904199475)
			#newlead.End = XYZ(356.970578035,123.606924636,78.904199475)
			leaders.append(lead)
			#vv = i.CanBeVisibleInView(v2)
			i.SetLeader(ends,v,lead)
			#i.HideBubble(b)
			
		except:
			import traceback
			errorReport = traceback.format_exc()
TransactionManager.Instance.TransactionTaskDone()

doc.Regenerate()

if errorReport == None:
    
	OUT = leaders
else:
	OUT = errorReport
# ----------------------------------------
