# Dynamo graph Create_ StairPaths_byView.dyn (Dynamo 1.3.3.4111)

code_block = CodeBlock { "FIRE RATING PLAN LEVEL"; }
code_block_2 = CodeBlock { false; true; }
python_script = Python(IN[0]=code_block, IN[1]=code_block_2.out0, IN[2]=code_block_2.out1)
# ---------- python_script.python (42 lines) ----------
#Copyright(c) 2016, Dimitar Venkov
# @5devene, dimitar.ven@gmail.com

import clr

clr.AddReference("RevitServices")
import RevitServices
from RevitServices.Persistence import DocumentManager
doc = DocumentManager.Instance.CurrentDBDocument

clr.AddReference("RevitAPI")
from Autodesk.Revit.DB import *

clr.AddReference("RevitNodes")
import Revit
clr.ImportExtensions(Revit.Elements)

def tolist(obj1):
	if hasattr(obj1,"__iter__"): return obj1
	else: return [obj1]

fn = map(str,tolist(IN[0]) )
IncSchedules = IN[1]
result, similar, names = [], [], []

if IncSchedules: exclude = ("DrawingSheet")
else: exclude = ("DrawingSheet", "Schedule")
fec = FilteredElementCollector(doc).OfClass(ViewPlan)
for i in fec:
	if not i.IsTemplate and not i.ViewType.ToString() in exclude:
		n1 = i.ViewName
		names.append(n1)
		if any(fn1 == n1 for fn1 in fn):
			result.append(i.ToDSType(True))
		elif any(fn1.lower() in n1.lower() for fn1 in fn):
			similar.append(i.ToDSType(True))
if len(result) > 0:
	OUT = result,similar
if len(result) == 0 and len(similar) > 0:
	OUT = "No exact match found. Check partial below:", similar
if len(result) == 0 and len(similar) == 0:
	OUT = "No match found! Check names below:", names
# ----------------------------------------
code_block_3 = CodeBlock(views=python_script) { views[1]; }
code_block_4 = CodeBlock(views=code_block_3) { views; }

# group: Create Stair Paths
python_script_2 = Python(IN[0]=code_block_4)
# ---------- python_script_2.python (49 lines) ----------
import clr
clr.AddReference('ProtoGeometry')
from Autodesk.DesignScript.Geometry import *

#Import DocumentManager
clr.AddReference("RevitServices")
import RevitServices
from RevitServices.Persistence import DocumentManager
from RevitServices.Transactions import TransactionManager

#Import RevitAPI
clr.AddReference("RevitAPI")
import Autodesk

#Import ToDSType(bool) extension method
clr.AddReference("RevitNodes")
import Revit
from Autodesk.Revit.DB import *
from Autodesk.Revit.Creation import *
clr.ImportExtensions(Revit.Elements)
clr.ImportExtensions(Revit.GeometryConversion)

views = UnwrapElement(IN[0])
doc = DocumentManager.Instance.CurrentDBDocument
stairswithpathlst = list()
stairslst = list()

# collect existing stairpaths in ActiveView
for v in views:
	collpath = FilteredElementCollector(doc, v.Id)
	filtpath = ElementCategoryFilter(BuiltInCategory.OST_StairsPaths)
	stairpaths = collpath.WherePasses(filtpath).ToElements()
	stairswithpath = []
	# get stairs from stair path
	for i in stairpaths:
		hoststair = (i.StairsId)
		stairid	= hoststair.HostElementId
		stairelem = doc.GetElement(stairid).ToDSType(True)	
		stairswithpath.append(stairelem)
		
	# collect stairs in ActiveView
	collstair = FilteredElementCollector(doc, v.Id)
	filtstair = ElementCategoryFilter(BuiltInCategory.OST_Stairs)
	stairs = collstair.WherePasses(filtstair).ToElements()
	
	stairswithpathlst.append(stairswithpath)
	stairslst.append(stairs)

OUT = stairslst, stairswithpathlst
# ----------------------------------------
code_block_5 = CodeBlock(out=python_script_2) { out[0]; out[1]; }

python_script_3 = Python(IN[0]=code_block_5.out0, IN[1]=code_block_5.out1)
# ---------- python_script_3.python (13 lines) ----------
listA = IN[0]
listB = IN[1]
unmatched = []

#listC = [x for x in listA if x not in listB]
for x in range(len(listA)):
#	s = set(listA)
	if listA[x] in listB:
		listB.remove(listA[x])
	else:
		unmatched.append(listA[x])

OUT = [listB, unmatched]
# ----------------------------------------

# group (continued): Create Stair Paths
flatten = Flatten(python_script_3@L3)
create_paths = Python(IN[0]=flatten, IN[1]=code_block_4)
# ---------- create_paths.python (84 lines) ----------
import clr
clr.AddReference('ProtoGeometry')
from Autodesk.DesignScript.Geometry import *

#Import DocumentManager
clr.AddReference("RevitServices")
import RevitServices
from RevitServices.Persistence import DocumentManager
from RevitServices.Transactions import TransactionManager

#Import RevitAPI
clr.AddReference("RevitAPI")
import Autodesk

#Import ToDSType(bool) extension method
clr.AddReference("RevitNodes")
import Revit
from Autodesk.Revit.DB import *
from Autodesk.Revit.Creation import *
clr.ImportExtensions(Revit.Elements)
clr.ImportExtensions(Revit.GeometryConversion)

import sys
#Specify location path for IronPython install
pyt_path = r'C:\Program Files (x86)\IronPython 2.7\Lib'
sys.path.append(pyt_path)


doc = DocumentManager.Instance.CurrentDBDocument
uidoc = DocumentManager.Instance.CurrentUIApplication.ActiveUIDocument
def ProcessList(_func, _list):
    return map( lambda x: ProcessList(_func, x) if type(x)==list else _func(x), _list )

def UnwrapNestedList(e):
	return UnwrapElement(e)
	
if isinstance(IN[0], list):
	stairs = ProcessList(UnwrapNestedList, IN[0])
else:
	stairs = [UnwrapElement(IN[0])]
if isinstance(IN[1], list):
	views = ProcessList(UnwrapNestedList, IN[1])
else:
	views = [UnwrapElement(IN[1])]	

typelist = list()

newpathslst = list()
TransactionManager.Instance.EnsureInTransaction(doc)


#find stairpathtype
collpathtype = FilteredElementCollector(doc)
filtpathtype = ElementCategoryFilter(BuiltInCategory.OST_StairsPaths)
stairpathtypes = collpathtype.WherePasses(filtpathtype).ToElements()

for stairpathtype in stairpathtypes:
	istype = stairpathtype.ToString()
	if istype == "Autodesk.Revit.DB.Architecture.StairsPathType":
		typelist.append(stairpathtype)

stairpathtype = typelist[0]
pathid = stairpathtype.Id

for v in views:
#create stair path for stair runs
	try:
		for st in stairs:
			newpaths = list()
			for stair in st:
				stairid = LinkElementId(stair.Id)
				newpath = Autodesk.Revit.DB.Architecture.StairsPath.Create(doc, stairid, pathid, v.Id)
				newpaths.append(newpath)
		newpathslst.append(newpaths)
	except:
		import traceback
		errorReport = traceback.format_exc()

TransactionManager.Instance.TransactionTaskDone()

doc.Regenerate()
uidoc.RefreshActiveView()

OUT = newpaths
# ----------------------------------------
code_block_6 = CodeBlock(stair_paths=create_paths) { stair_paths; }

code_block_7 = CodeBlock { true; }
code_block_8 = CodeBlock { "*"; }
python_script_4 = Python(IN[0]=code_block_7, IN[1]=code_block_8)
# ---------- python_script_4.python (77 lines) ----------
#Copyright(c) 2014, Nathan Miller
# The Proving Ground, http://theprovingground.org

import clr

# Import RevitAPI
clr.AddReference("RevitAPI")
import Autodesk
from Autodesk.Revit.DB import *

# Import DocumentManager and TransactionManager
clr.AddReference("RevitServices")
import RevitServices
from RevitServices.Persistence import DocumentManager
from RevitServices.Transactions import TransactionManager

# Import ToDSType(bool) extension method
clr.AddReference("RevitNodes")
import Revit
clr.ImportExtensions(Revit.Elements)
clr.ImportExtensions(Revit.GeometryConversion)

#The input to this node will be stored in the IN[0] variable.

doc =  DocumentManager.Instance.CurrentDBDocument

toggle = IN[0]
schemeName = IN[1]

output = []
views = []
names = []
elementids = []
uniqueids = []

if toggle == True:

	collector = FilteredElementCollector(doc)
	collector.OfCategory(BuiltInCategory.OST_Views)
	collector.OfClass(View)
 
	famtypeitr = collector.GetElementIdIterator()
	famtypeitr.Reset()

	for item in famtypeitr:
		famtypeID = item
		faminst = doc.GetElement(famtypeID)
		
		if faminst.ViewType == ViewType.AreaPlan:
			if (faminst.AreaScheme.Name == schemeName):
				view = faminst
				name = faminst.Name
				elementid = faminst.Id
				uniqueid = faminst.UniqueId
				
				views.append(view)
				names.append(name)
				elementids.append(elementid)
				uniqueids.append(uniqueid)
			if (schemeName == "*"):
				view = faminst
				name = faminst.Name
				elementid = faminst.Id
				uniqueid = faminst.UniqueId
				
				views.append(view)
				names.append(name)
				elementids.append(elementid)
				uniqueids.append(uniqueid)
        
	output.append(views)
	output.append(names)
	output.append(elementids)
	output.append(uniqueids)
        
#Assign your output to the OUT variable
OUT = output
# ----------------------------------------
code_block_9 = CodeBlock(areaplans=python_script_4) { areaplans[0]; }
code_block_10 = CodeBlock {  }
